# Dynamo graph ConcreteFormwork_v1.0.dyn (Dynamo 2.19.3.6394)

# group: Collect All Structural Elements
categories = Categories("OST_Floors")
all_elements_of_category = ElementsOfCategory(Category=categories)
categories_2 = Categories("OST_StructuralColumns")
all_elements_of_category_2 = ElementsOfCategory(Category=categories_2)
categories_3 = Categories("OST_Stairs")
all_elements_of_category_3 = ElementsOfCategory(Category=categories_3)
categories_4 = Categories("OST_StructuralFraming")
all_elements_of_category_4 = ElementsOfCategory(Category=categories_4)
categories_5 = Categories("OST_Walls")
all_elements_of_category_5 = ElementsOfCategory(Category=categories_5)
categories_6 = Categories("OST_StructuralFoundation")
all_elements_of_category_6 = ElementsOfCategory(Category=categories_6)
list_create = List.Create(item0=all_elements_of_category, item1=all_elements_of_category_2, item2=all_elements_of_category_3, item3=all_elements_of_category_4, item4=all_elements_of_category_5, item5=all_elements_of_category_6)
flatten = List.Flatten(list=list_create)

# group: GET FORMWORK SURFACES
solids = Element.Solids(element=flatten)
flatten_2 = List.Flatten(list=solids)
byUnion = Solid.ByUnion(solids=flatten_2)
explode = Geometry.Explode(geometry=byUnion)
flatten_3 = List.Flatten(list=explode)
code_block = CodeBlock { 0.5; }
pointAtParameter = Surface.PointAtParameter(surface=flatten_3, u=code_block, v=code_block)
normalAtPoint = Surface.NormalAtPoint(surface=flatten_3, point=pointAtParameter)
Z = Vector.Z(vector=normalAtPoint)
code_block_2 = CodeBlock { 2; }
round = Math.Round(number=Z, digits=code_block_2)
code_block_3 = CodeBlock(V=round) { V>0; }
Z_2 = Point.Z(point=pointAtParameter)
code_block_foundation_elevation = CodeBlock { -0.45; }
code_block_4 = CodeBlock(Z=Z_2, h=code_block_foundation_elevation) { Z<h; }
list_create_2 = List.Create(item0=code_block_3, item1=code_block_4)
transpose = List.Transpose(lists=list_create_2)
countFalse = List.CountFalse(list=transpose@L2)
code_block_5 = CodeBlock(F=countFalse) { F==2; }
filterByBoolMask = List.FilterByBoolMask(list=flatten_3, mask=code_block_5)
code_block_6 = CodeBlock { 0.0125; }
offset = Surface.Offset(surface=filterByBoolMask.in, distance=code_block_6)
code_block_7 = CodeBlock { -0.025; }
thicken = Surface.Thicken(surface=offset, thickness=code_block_7)
code_block_8 = CodeBlock { 255; 255; 0; 0; }
byARGB = Color.ByARGB(alpha=code_block_8.out0, red=code_block_8.out1, green=code_block_8.out2, blue=code_block_8.out3)
byGeometryColor = Modifiers.GeometryColor.ByGeometryColor(geometry=filterByBoolMask.out, color=byARGB)

# group: SET FORMWORK
categories_7 = Categories("OST_GenericModel")
id = Element.Id(element=byGeometry)
code_block_9 = CodeBlock(n=id) { "Wood - Formwork"; "Formwork_Area"; "Formwork " + n; "Mark"; }
byName = Material.ByName(name=code_block_9.out0)
byGeometry = DirectShape.ByGeometry(geometry=thicken, category=categories_7, material=byName, name=code_block_9.out0)
area = Surface.Area(surface=filterByBoolMask.in)
convert_by_units = DynamoUnitConvert(area, MeasurementType="autodesk.unit.quantity:area-1.0.2", FromConversion="autodesk.unit.unit:squareMeters-1.0.1", ToConversion="autodesk.unit.unit:squareMeters-1.0.1")
code_block_10 = CodeBlock { 3; }
round_2 = Math.Round(number=convert_by_units, digits=code_block_10)
setParameterByName = Element.SetParameterByName(element=byGeometry, parameterName=code_block_9.out1, value=round_2)
setParameterByName_2 = Element.SetParameterByName(element=setParameterByName, parameterName=code_block_9.out3, value=code_block_9.out2)

# group: Create Formwork Material
string_material_name = StringInput("Wood - Formwork")
code_block_11 = CodeBlock { 255; 213; 176; 108; }
byARGB_2 = Color.ByARGB(alpha=code_block_11.out0, red=code_block_11.out1, green=code_block_11.out2, blue=code_block_11.out3)
string_material_description = StringInput("Spruce")
string_material_class_name = StringInput("Wood")
python_script = Python(IN[0]=string_material_name, IN[1]=byARGB_2, IN[2]=string_material_description, IN[3]=string_material_class_name)  # CPython3
# ---------- python_script.python (72 lines) ----------
# Load the Python Standard and DesignScript Libraries
import sys
import clr
clr.AddReference('ProtoGeometry')
from Autodesk.DesignScript.Geometry import *

# The inputs to this node will be stored as a list in the IN variables.
dataEnteringNode = IN

# Place your code below this line

import clr
clr.AddReference('RevitServices')
from RevitServices.Persistence import DocumentManager
from RevitServices.Transactions import TransactionManager

clr.AddReference('RevitAPI')
from Autodesk.Revit.DB import FilteredElementCollector, Material, Color

# Get the Revit document
doc = DocumentManager.Instance.CurrentDBDocument

# Input parameters from Dynamo
material_name = IN[0]  # Material name from String node
color = IN[1]          # Color from Color.ByARGB node
description = IN[2]    # Description from String node
class_name = IN[3]     # Class from String node

# Function to find material by name
def find_material_by_name(doc, name):
    materials = FilteredElementCollector(doc).OfClass(Material).ToElements()
    for mat in materials:
        if mat.Name == name:
            return mat
    return None

# Start a transaction to create or modify the material
TransactionManager.Instance.EnsureInTransaction(doc)

# Check if the material exists
material = find_material_by_name(doc, material_name)

if material is None:
    # Create a new material if it does not exist
    material = Material.Create(doc, material_name)

TransactionManager.Instance.TransactionTaskDone()  # Commit the transaction

# Ensure the material is properly initialized by finding it again
material = find_material_by_name(doc, material_name)

# Start a new transaction to set the parameters
TransactionManager.Instance.EnsureInTransaction(doc)

# Set the Description and Class
description_param = material.LookupParameter("Description")
if description_param:
    description_param.Set(description)

class_param = material.LookupParameter("Class")
if class_param:
    class_param.Set(class_name)

# Set the color of the material for Shading and Surface Pattern - Foreground (Graphics Tab)
if color:
    # Set the shading color
    material.Color = Color(color.Red, color.Green, color.Blue)

TransactionManager.Instance.TransactionTaskDone()

# Output the result
OUT = "Material updated: " + material_name
# ----------------------------------------
watch = Watch(python_script)

# group: CREATE PROJECT PARAMETER
string = StringInput("Formwork_Area")
string_2 = StringInput("Common")
spec_types = SpecTypes("autodesk.spec.aec:area")
group_types = GroupTypes("autodesk.parameter.group:dimensions")
boolean = BoolSelector(true)
categories_8 = Categories("OST_GenericModel")
list_create_3 = List.Create(item0=categories_8)
createProjectParameter = Parameter.CreateProjectParameter(parameterName=string, groupName=string_2, specType=spec_types, groupType=group_types, instance=boolean, categoryList=list_create_3)

# group: SET FORMWORK > Formwork Area [m2]
sum = Math.Sum(values=round_2)
